# Grasshopper definition Fuso.gh (Grasshopper 1.0.7)
# plug-ins: HelixGH

comprimento_l = Slider(100, range=0..500)
# GNU nano 7.2                                    Fuso.md                                             | **Parte** | **Tamanho** | **Profundidade** |
# |---|---|---|
# | Comprimento (L) | 20xD | - |
# | Diametro (D) | L/20 | - |
# | Passo da Rosca (P) | P=D | - |
# | Zona de Aliemntação (ZA) | Lx0.3 | Dx0.12 |
# | Zona de Compressão (ZC) | Lx0.4 | |
# | Zona de Dosagem (ZD) | Lx0.3 | Dx(0.03 ~ 0.05) |
# | Angulo | 17º ~ 20º | - |
multiplication = Multiplication(A=comprimento_l, B=10)

# ---- group: Zona de Dosagem (ZD)
multiplication_2 = Multiplication(A=multiplication, B="0.3")

# ---- group: Zona de Alimentação (ZA)
multiplication_3 = Multiplication(A=multiplication, B="0.3")

# ---- group: Zona de Compressão (ZC)
multiplication_4 = Multiplication(A=multiplication, B="0.4")

# ---- group: Diametro
l_20 = Panel("20")
division = Division(A=multiplication, B=l_20)

# ---- group: profundidade ZA
multiplication_5 = Multiplication(A=division, B="0.12")

# ----
X = UnitX(Factor=multiplication_5)

division_2 = Division(A=multiplication, B=division)
paso_da_rosca_p = Data(division)
helix_curve = HelixCurve(Diameter=division, Taper=1, Infinite="true", Pitch=paso_da_rosca_p, Turns=division_2, Reverse=False)  # -> Helix, Height

Z = UnitZ(Factor=Slider(2.5, range=0..10))

division_3 = Division(A=division, B=2)
cir = Circle(Plane=PlaneXY(0, 0, 0), Radius=division_3)
Z_2 = UnitZ(Factor=multiplication)
srf = Surface(cir)
extr = Extrude(Base=srf, Direction=Z_2)  # -> flatten(Extrusion)

divide = DivideCurve(Curve=helix_curve.Helix, Count="3", Kinks=False)  # -> Points, Tangents, Parameters
item = ListItem(List=divide.Points, Index=0, Wrap=True)
xz = XZPlane(Origin=item)
neg = Negative(Value=Z)
item_2 = ListItem(List=divide.Points, Index="3", Wrap=True)
data = Data(item_2)
data_2 = Data(helix_curve.Helix)
pt = ConstructPoint(XCoordinate="0", YCoordinate="0", ZCoordinate="0")
Z_3 = UnitZ(Factor="3")
ln = Line(StartPoint=pt, EndPoint=Z_3)

pt_2 = Point(xz)

move = Move(Geometry=pt_2, Motion=Z)  # -> Geometry, Transform
move_2 = Move(Geometry=move.Geometry, Motion=expr("x*-1", X))  # -> Geometry, Transform
ln_2 = Line(StartPoint=pt_2, EndPoint=move.Geometry)
xz_2 = XZPlane(Origin=move.Geometry)

ln_3 = Line(StartPoint=move.Geometry, EndPoint=move_2.Geometry)
rotate = Rotate(Geometry=ln_3, Angle="-0.349", Plane=xz_2)  # -> Geometry, Transform

move_3 = Move(Geometry=ln_3, Motion=neg)  # -> Geometry, Transform
join = JoinCurves(Curves=[rotate.Geometry, ln_2], Preserve=False)
mirror = MirrorCurve(Geometry=join, Curve=move_3.Geometry, Tangent=True)
join_2 = JoinCurves(Curves=[join, mirror], Preserve=False)
move_4 = Move(Geometry=join_2, Motion=data)  # -> Geometry, Transform
railrev = RailRevolution(Curve=join_2, Rail=data_2, Axis=ln, Scale=False)
